# Dynamo graph Batch Prefix Room Names v1.0.0.dyn (Dynamo 1.0.0.1180)

categories = Categories("Rooms")
all_elements_of_category = ElementsOfCategory(categories)
watch = Watch(all_elements_of_category)
code_block = CodeBlock { "Name"; }
code_block_2 = CodeBlock { "abc_"; }
getParameterValueByName = Element.GetParameterValueByName(element=watch, parameterName=code_block)
code_block_3 = CodeBlock(x=code_block_2, y=getParameterValueByName) { x+y; }
setParameterByName = Element.SetParameterByName(element=watch, parameterName=code_block, value=code_block_3)
